% Simulink data dictionary Elem9_L5_NL4.sldd

ePar1 = Simulink.Bus()
  m: double[2 2]
  k: double[2 2]
  type: double
  dofs: double[2 2]
  nvars: double
  alpha: double
  beta: double
  gamma: double
  d0: double
  d1: double
  a0: double
  a1: double
  ndofs: double
  M: double[4 4]
  c: double[2 2]
  B: double[4 2]
  Bbar: double[10 2]
  G_d: double[1 4]
  G_f: double[2 4]
  Gbar_d: double[1 4]
  Gbar_f: double[2 6]

ePar2 = Simulink.Bus()
  m: double[2 2]
  k: double[2 2]
  type: double
  dofs: double[2 2]
  nvars: double
  alpha: double
  beta: double
  gamma: double
  d0: double
  d1: double
  a0: double
  a1: double
  ndofs: double
  M: double[4 4]
  c: double[2 2]
  B: double[4 2]
  Bbar: double[10 2]
  G_d: double[1 4]
  G_f: double[2 4]
  Gbar_d: double[1 4]
  Gbar_f: double[2 6]

ePar3 = Simulink.Bus()
  m: double[2 2]
  k: double[2 2]
  type: double
  dofs: double[2 2]
  nvars: double
  alpha: double
  beta: double
  gamma: double
  d0: double
  d1: double
  a0: double
  a1: double
  ndofs: double
  M: double[4 4]
  c: double[2 2]
  B: double[4 2]
  Bbar: double[10 2]
  G_d: double[1 4]
  G_f: double[2 4]
  Gbar_d: double[1 4]
  Gbar_f: double[2 6]

ePar4 = Simulink.Bus()
  m: double[2 2]
  k: double[2 2]
  type: double
  dofs: double[2 2]
  nvars: double
  alpha: double
  beta: double
  gamma: double
  d0: double
  d1: double
  a0: double
  a1: double
  ndofs: double
  M: double[5 5]
  c: double[2 2]
  B: double[5 2]
  Bbar: double[10 2]
  G_d: double[1 5]
  G_f: double[1 5]
  Gbar_d: double[1 4]
  Gbar_f: double[1 6]

ePar5 = Simulink.Bus()
  m: double[2 2]
  k: double[2 2]
  type: double
  dofs: double[2 2]
  nvars: double
  alpha: double
  beta: double
  gamma: double
  d0: double
  d1: double
  a0: double
  a1: double
  ndofs: double
  M: double[5 5]
  c: double[2 2]
  B: double[5 2]
  Bbar: double[10 2]
  G_d: double[1 5]
  G_f: double[2 5]
  Gbar_d: double[1 4]
  Gbar_f: double[2 6]

ePar6 = Simulink.Bus()
  m: double[2 2]
  k: double[2 2]
  type: double
  dofs: double[2 2]
  nvars: double
  alpha: double
  beta: double
  gamma: double
  d0: double
  d1: double
  a0: double
  a1: double
  ndofs: double
  M: double[5 5]
  c: double[2 2]
  B: double[5 2]
  Bbar: double[10 2]
  G_d: double[1 5]
  G_f: double[2 5]
  Gbar_d: double[1 4]
  Gbar_f: double[2 6]

ePar7 = Simulink.Bus()
  m: double[2 2]
  k: double[2 2]
  type: double
  dofs: double[2 2]
  nvars: double
  alpha: double
  beta: double
  gamma: double
  d0: double
  d1: double
  a0: double
  a1: double
  ndofs: double
  M: double[5 5]
  c: double[2 2]
  B: double[5 2]
  Bbar: double[10 2]
  G_d: double[1 5]
  G_f: double[1 5]
  Gbar_d: double[1 4]
  Gbar_f: double[1 6]

ePar8 = Simulink.Bus()
  m: double[2 2]
  k: double[2 2]
  type: double
  dofs: double[2 2]
  nvars: double
  alpha: double
  beta: double
  gamma: double
  d0: double
  d1: double
  a0: double
  a1: double
  ndofs: double
  M: double[4 4]
  c: double[2 2]
  B: double[4 2]
  Bbar: double[10 2]
  G_d: double[1 4]
  G_f: double[1 4]
  Gbar_d: double[1 4]
  Gbar_f: double[1 6]

ePar9 = Simulink.Bus()
  m: double[2 2]
  k: double[2 2]
  type: double
  dofs: double[2 2]
  nvars: double
  alpha: double
  beta: double
  gamma: double
  d0: double
  d1: double
  a0: double
  a1: double
  ndofs: double
  M: double[4 4]
  c: double[2 2]
  B: double[4 2]
  Bbar: double[10 2]
  G_d: double[1 4]
  G_f: double[1 4]
  Gbar_d: double[1 4]
  Gbar_f: double[1 6]

element = [struct(
  m=[100 0; 0 100],
  k=[10 -10; -10 10],
  type=1,
  dofs=[1 1; 2 1],
  nvars=0,
  alpha=0,
  beta=0,
  gamma=0,
  d0=0,
  d1=0,
  a0=0,
  a1=0,
  ndofs=2,
  M=[1 0 0 0; 0 1 0 0; 0 0 100 0; 0 0 0 100],
  c=[0 0; 0 0],
  B=[0 0; 0 0; 1 0; 0 1],
  Bbar=[-1 0
   0 -1
   0 0
   0 0
   0 0
   0 0
   0 0
   0 0
   0 0
   0 0],
  G_d=[0 0 0 0],
  G_f=[1 0 0 0; 0 1 0 0],
  Gbar_d=[0 0 0 0],
  Gbar_f=[-1 0 0 0 0 0; 0 -1 0 0 0 0]), struct(
  m=[100 0; 0 100],
  k=[10 -10; -10 10],
  type=1,
  dofs=[2 1; 3 1],
  nvars=0,
  alpha=0,
  beta=0,
  gamma=0,
  d0=0,
  d1=0,
  a0=0,
  a1=0,
  ndofs=2,
  M=[1 0 0 0; 0 1 0 0; 0 0 100 0; 0 0 0 100],
  c=[0 0; 0 0],
  B=[0 0; 0 0; 1 0; 0 1],
  Bbar=[0 0
   -1 0
   0 -1
   0 0
   0 0
   0 0
   0 0
   0 0
   0 0
   0 0],
  G_d=[0 0 0 0],
  G_f=[1 0 0 0; 0 1 0 0],
  Gbar_d=[0 0 0 0],
  Gbar_f=[0 -1 0 0 0 0; 0 0 -1 0 0 0]), struct(
  m=[100 0; 0 100],
  k=[10 -10; -10 10],
  type=1,
  dofs=[3 1; 4 1],
  nvars=0,
  alpha=0,
  beta=0,
  gamma=0,
  d0=0,
  d1=0,
  a0=0,
  a1=0,
  ndofs=2,
  M=[1 0 0 0; 0 1 0 0; 0 0 100 0; 0 0 0 100],
  c=[0 0; 0 0],
  B=[0 0; 0 0; 1 0; 0 1],
  Bbar=[0 0
   0 0
   -1 0
   0 -1
   0 0
   0 0
   0 0
   0 0
   0 0
   0 0],
  G_d=[0 0 0 0],
  G_f=[1 0 0 0; 0 1 0 0],
  Gbar_d=[0 0 0 0],
  Gbar_f=[0 0 -1 0 0 0; 0 0 0 -1 0 0]), struct(
  m=[1 0; 0 1],
  k=[1 -1; -1 1],
  type=3,
  dofs=[1 1; 5 1],
  nvars=1,
  alpha=0,
  beta=0,
  gamma=0,
  d0=0.0015,
  d1=0.07,
  a0=0,
  a1=0,
  ndofs=2,
  M=[1 0 0 0 0
   0 1 0 0 0
   0 0 1 0 0
   0 0 0 1 0
   0 0 0 0 1],
  c=[0 0; 0 0],
  B=[0 0; 0 0; 1 0; 0 1; 0 0],
  Bbar=[-1 0
   0 0
   0 0
   0 0
   0 -1
   0 0
   0 0
   0 0
   0 0
   0 0],
  G_d=[0 1 0 0 0],
  G_f=[1 0 0 0 0],
  Gbar_d=[-1 0 0 0],
  Gbar_f=[-1 0 0 0 0 0]), struct(
  m=[1 0; 0 1],
  k=[1 -1; -1 1],
  type=3,
  dofs=[2 1; 6 1],
  nvars=1,
  alpha=0,
  beta=0,
  gamma=0,
  d0=0.0015,
  d1=0.07,
  a0=0,
  a1=0,
  ndofs=2,
  M=[1 0 0 0 0
   0 1 0 0 0
   0 0 1 0 0
   0 0 0 1 0
   0 0 0 0 1],
  c=[0 0; 0 0],
  B=[0 0; 0 0; 1 0; 0 1; 0 0],
  Bbar=[0 0
   -1 0
   0 0
   0 0
   0 0
   0 -1
   0 0
   0 0
   0 0
   0 0],
  G_d=repmat(0, 1, 5),
  G_f=[1 0 0 0 0; 0 1 0 0 0],
  Gbar_d=[0 0 0 0],
  Gbar_f=[0 -1 0 0 0 0; 0 0 0 0 -1 0]), struct(
  m=[1 0; 0 1],
  k=[1 -1; -1 1],
  type=3,
  dofs=[3 1; 7 1],
  nvars=1,
  alpha=0,
  beta=0,
  gamma=0,
  d0=0.0015,
  d1=0.07,
  a0=0,
  a1=0,
  ndofs=2,
  M=[1 0 0 0 0
   0 1 0 0 0
   0 0 1 0 0
   0 0 0 1 0
   0 0 0 0 1],
  c=[0 0; 0 0],
  B=[0 0; 0 0; 1 0; 0 1; 0 0],
  Bbar=[0 0
   0 0
   -1 0
   0 0
   0 0
   0 0
   0 -1
   0 0
   0 0
   0 0],
  G_d=repmat(0, 1, 5),
  G_f=[1 0 0 0 0; 0 1 0 0 0],
  Gbar_d=[0 0 0 0],
  Gbar_f=[0 0 -1 0 0 0; 0 0 0 0 0 -1]), struct(
  m=[1 0; 0 1],
  k=[1 -1; -1 1],
  type=3,
  dofs=[4 1; 8 1],
  nvars=1,
  alpha=0,
  beta=0,
  gamma=0,
  d0=0.0015,
  d1=0.07,
  a0=0,
  a1=0,
  ndofs=2,
  M=[1 0 0 0 0
   0 1 0 0 0
   0 0 1 0 0
   0 0 0 1 0
   0 0 0 0 1],
  c=[0 0; 0 0],
  B=[0 0; 0 0; 1 0; 0 1; 0 0],
  Bbar=[0 0
   0 0
   0 0
   -1 0
   0 0
   0 0
   0 0
   0 -1
   0 0
   0 0],
  G_d=[0 1 0 0 0],
  G_f=[1 0 0 0 0],
  Gbar_d=[0 -1 0 0],
  Gbar_f=[0 0 0 -1 0 0]), struct(
  m=[1 0; 0 0.1],
  k=[1 -1; -1 1],
  type=1,
  dofs=[6 1; 9 1],
  nvars=0,
  alpha=0,
  beta=0,
  gamma=0,
  d0=0,
  d1=0,
  a0=0,
  a1=0,
  ndofs=2,
  M=[1 0 0 0; 0 1 0 0; 0 0 1 0; 0 0 0 0.1],
  c=[0 0; 0 0],
  B=[0 0; 0 0; 1 0; 0 1],
  Bbar=[0 0
   0 0
   0 0
   0 0
   0 0
   -1 0
   0 0
   0 0
   0 -1
   0 0],
  G_d=[0 1 0 0],
  G_f=[1 0 0 0],
  Gbar_d=[0 0 -1 0],
  Gbar_f=[0 0 0 0 -1 0]), struct(
  m=[1 0; 0 0.1],
  k=[1 -1; -1 1],
  type=1,
  dofs=[7 1; 10 1],
  nvars=0,
  alpha=0,
  beta=0,
  gamma=0,
  d0=0,
  d1=0,
  a0=0,
  a1=0,
  ndofs=2,
  M=[1 0 0 0; 0 1 0 0; 0 0 1 0; 0 0 0 0.1],
  c=[0 0; 0 0],
  B=[0 0; 0 0; 1 0; 0 1],
  Bbar=[0 0
   0 0
   0 0
   0 0
   0 0
   0 0
   -1 0
   0 0
   0 0
   0 -1],
  G_d=[0 1 0 0],
  G_f=[1 0 0 0],
  Gbar_d=[0 0 0 -1],
  Gbar_f=[0 0 0 0 0 -1])]

mPar = Simulink.Bus()
  dofs_f: double[6 2]
  dofs_d: double[4 2]
  dofs: double[10 2]
  Bbar_d: double[10 4]
  Bbar_f: double[10 6]

model = struct(
  dofs_f=[1 1; 2 1; 3 1; 4 1; 6 1; 7 1],
  dofs_d=[5 1; 8 1; 9 1; 10 1],
  dofs=[1 1
   2 1
   3 1
   4 1
   5 1
   6 1
   7 1
   8 1
   9 1
   10 1],
  Bbar_d=[0 0 0 0
   0 0 0 0
   0 0 0 0
   0 0 0 0
   1 0 0 0
   0 0 0 0
   0 0 0 0
   0 1 0 0
   0 0 1 0
   0 0 0 1],
  Bbar_f=[1 0 0 0 0 0
   0 1 0 0 0 0
   0 0 1 0 0 0
   0 0 0 1 0 0
   0 0 0 0 0 0
   0 0 0 0 1 0
   0 0 0 0 0 1
   0 0 0 0 0 0
   0 0 0 0 0 0
   0 0 0 0 0 0])