% Simulink data dictionary model_2springs.sldd

ePar1 = Simulink.Bus()
  m: double[2 2]
  k: double[2 2]
  dofs: double[2 2]
  nvars: double
  a0: double
  a1: double
  ndofs: double
  M: double[4 4]
  c: double[2 2]
  B: double[4 2]
  Bbar: double[3 2]
  G_d: double[1 4]
  G_f: double[1 4]
  Gbar_d: double
  Gbar_f: double[1 2]

ePar2 = Simulink.Bus()
  m: double[2 2]
  k: double[2 2]
  alpha: double
  beta: double
  gamma: double
  n: double
  dofs: double[2 2]
  nvars: double
  d0: double
  d1: double
  a0: double
  a1: double
  ndofs: double
  M: double[5 5]
  c: double[2 2]
  B: double[5 2]
  Bbar: double[3 2]
  G_d: double[1 5]
  G_f: double[2 5]
  Gbar_d: double
  Gbar_f: double[2 2]

element = {struct(
  m=[100 0; 0 100],
  k=[100 -100; -100 100],
  dofs=[1 1; 2 1],
  nvars=0,
  a0=0,
  a1=0,
  ndofs=2,
  M=[1 0 0 0; 0 1 0 0; 0 0 100 0; 0 0 0 100],
  c=[0 0; 0 0],
  B=[0 0; 0 0; 1 0; 0 1],
  Bbar=[-1 0; 0 -1; 0 0],
  G_d=[0 0 1 0],
  G_f=[0 0 0 1],
  Gbar_d=-1,
  Gbar_f=[-1 0]), struct(
  m=[200 0; 0 200],
  k=[0 0; 0 0],
  alpha=50,
  beta=0.5,
  gamma=0,
  n=1,
  dofs=[2 1; 3 1],
  nvars=1,
  d0=0,
  d1=0,
  a0=0,
  a1=0,
  ndofs=2,
  M=[1 0 0 0 0
   0 1 0 0 0
   0 0 200 0 0
   0 0 0 200 0
   0 0 0 0 1],
  c=[0 0; 0 0],
  B=[0 0; 0 0; 1 0; 0 1; 0 0],
  Bbar=[0 0; -1 0; 0 -1],
  G_d=repmat(0, 1, 5),
  G_f=[0 0 1 0 0; 0 0 0 1 0],
  Gbar_d=0,
  Gbar_f=[-1 0; 0 -1])}

mPar = Simulink.Bus()
  dofs_f: double[2 2]
  dofs_d: double[1 2]
  tmax: double
  dt: double
  PS: double[1 3]
  dofs: double[3 2]
  ndofs_ext: double
  ndofs: double
  Bbar_d: double[3 1]
  Bbar_f: double[3 2]

model = struct(
  dofs_f=[2 1; 3 1],
  dofs_d=[1 1],
  tmax=20,
  dt=0.02,
  PS=[2 1 2],
  dofs=[1 1; 2 1; 3 1],
  ndofs_ext=4,
  ndofs=3,
  Bbar_d=[1; 0; 0],
  Bbar_f=[0 0; 1 0; 0 1])